# Grasshopper definition FindSupportsTools.gh (Grasshopper 1.0.7)
# plug-ins: MeshEdit Components, Karamba3D, Bifocals

z = Slider(34, range=0..60)
a = Slider(0.845, range=-3.142..3.142)
s = Slider(9, range=0..10)
pt = Point([Point(17.29693774, 3.376393525, 0), Point(-11.6616662, 13.88925757, 0), Point(-14.46073973, 9.013896876, 0), Point(-12.66743185, -8.638456707, 0), Point(-8.589773668, -10.1455948, 0), Point(17.06268041, -1.553489241, 0)])
range = Range(Domain=z, Steps=s)
range_2 = Range(Domain=a, Steps=s)
Z = UnitZ(Factor=range)
prot = RotatePlane(Plane=Z, Angle=range_2)
orient = Orient(Geometry=graft(pt), Source=PlaneXY(0, 0, 0), Target=prot)  # -> Geometry, Transform
c = Slider(10, range=0..30)
c_2 = Slider(30, range=0..30)
nurbs = NurbsCurve(Vertices=orient.Geometry, Degree=3, Periodic=False)  # -> Curve, Length, Domain
item = ListItem(List=flatten(nurbs.Curve), Index=0, Wrap=True)
range_3 = Range(Domain=Domain(0, 1), Steps=c_2)  # -> graft(Range)
divide = DivideCurve(Curve=reparameterize(item), Count=c, Kinks=False)  # -> Points, Tangents, Parameters
loft = Loft(
    Curves=flatten(nurbs.Curve),
    Options={Adjust=False, Closed=True, LoftEnds=0, LoftSimp=0, LoftType=0, Rebuild=10, Refit=0.01})
vec = VectorXYZ(XComponent=range_3, YComponent=divide.Parameters, ZComponent=0)  # -> Vector, Length
evalsrf = EvaluateSurface(Surface=reparameterize(loft), Point=vec.Vector)  # -> Point, Normal, UDirection, VDirection, Frame
frompoints = MeshFromPoints(Points=flatten(evalsrf.Point), UDirection=expr("x+1", c_2), VDirection=expr("x+1", c))
mesh_edges = MeshEdges(Mesh=frompoints)  # -> NakedEdges, InteriorEdges, NonManifoldEdges; disabled
cross_section_karamba3d = CrossSectionKaramba3D(FamilyNameOfCrossSection="DefaultCroSec", Material=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, Height_cm="20", mode="Shell - Const")
list_item = ListItem(List=flatten(nurbs.Curve), Index=Slider(0, range=0..5), Wrap=True)
mesh_to_shell_karamba3d = MeshToShellKaramba3D(Mesh=frompoints, CrossSection=cross_section_karamba3d, LimitDistance_m=0.005)  # -> Element, Points, Info

# ---- group: XYZ Value Inside Domain or near given Value
tolerance = Slider(0.001, range=0.001..5)
construct_domain = ConstructDomain(DomainStart=Slider(-10, range=-20..20), DomainEnd=Slider(14, range=-20..20))  # disabled
panel = Panel("-5 To 20")  # disabled
point = Point(mesh_to_shell_karamba3d.Points)
cluster = Cluster(point=point, X=panel, Y=construct_domain, Z="0", tolerance=tolerance)

# ---- group: Inside or Near Box/Brep
tolerance_2 = Slider(0, range=0..1)
point_2 = Point(mesh_to_shell_karamba3d.Points)
brep = Brep(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)
cluster_2 = Cluster_2(point=point_2, box=brep, strict=Toggle(False), tolerance=tolerance_2)

# ---- group: Close to Curve
tolerance_3 = Slider(1, range=0..1)
point_3 = Point(mesh_to_shell_karamba3d.Points)
curve = Curve(list_item)
cluster_3 = Cluster_3(point=point_3, curve=curve, tolerance=tolerance_3)

# ---- group: Close to Surface
tolerance_4 = Slider(1, range=0..1)
point_4 = Point(mesh_to_shell_karamba3d.Points)
surface = Surface(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)
cluster_4 = Cluster_4(point=point_4, surface=surface, tolerance=tolerance_4)

# ----
point_5 = Point(cluster)
support_karamba3d = SupportKaramba3D(PosInd=point_5, menu=[buttons(on, on, on, off, off, on)])
loads_karamba3d = LoadsKaramba3D(Vector=Vector(0, 0, -1), LCase="0", mode="Gravity")
assemble_model_karamba3d = AssembleModelKaramba3D(Elem=mesh_to_shell_karamba3d.Element, Support=support_karamba3d, Load=loads_karamba3d, LimitDistance_m=0.005)  # -> Model, Info, Mass_kg, CenterOfGravity, LoadCaseNames
analyze_karamba3d = AnalyzeKaramba3D(Model=assemble_model_karamba3d.Model)  # -> CalculatedModel, MaximumDisplacement_cm, ResultingForceOfGravity_kN, ElasticEnergyChange_kNm
model_view_karamba3d = ModelViewKaramba3D(Model=analyze_karamba3d.CalculatedModel, ResultFactors=1, ResultCase=-1)  # -> Model, DeformedMesh, DeformedAxes, DeformedModel
shell_view_karamba3d = ShellViewKaramba3D(Model=model_view_karamba3d.Model, IndexOfLayer=0)  # -> Model, MeshesOfRenderedShells, LegendColors, LegendTags
rendered_view_karamba3d_pui = RenderedViewKaramba3D_PUI(
    Model=model_view_karamba3d.Model,
    Breps=invert(False),
    Loads="False",
    Supports=invert("False"),
    SupportsScale=Slider(3, range=0..5),
    Reactions="False",
    Joints="False")  # -> Model, Loads, Supports, Reactions, Joints
panel_2 = Panel("black")  # disabled
mesh_colours = MeshColours(Mesh=shell_view_karamba3d.MeshesOfRenderedShells, Colours=panel_2)  # disabled
custom_preview = CustomPreview(Geometry=rendered_view_karamba3d_pui.Supports, Material=ColourSwatch(SwatchColor=RGBA(0, 178, 15, 150)))

# ==== cluster Cluster
tolerance = ClusterInput()
point = ClusterInput()
X = ClusterInput()
Y = ClusterInput()
Z = ClusterInput()
tolerance_2 = Number(tolerance)
point_2 = Point(point)
X_2 = Domain(X)
Y_2 = Domain(Y)
Z_2 = Domain(Z)
deconstruct = Deconstruct(Point=point_2)  # -> XComponent, YComponent, ZComponent
deconstruct_domain = DeconstructDomain(Domain=X_2)  # -> Start, End
deconstruct_domain_2 = DeconstructDomain(Domain=Y_2)  # -> Start, End
deconstruct_domain_3 = DeconstructDomain(Domain=Z_2)  # -> Start, End
absolute = Absolute(Value=tolerance_2)
subtraction = Subtraction(A=deconstruct_domain.Start, B=absolute)
addition = Addition(A=deconstruct_domain.End, B=absolute)
subtraction_2 = Subtraction(A=deconstruct_domain_2.Start, B=absolute)
addition_2 = Addition(A=deconstruct_domain_2.End, B=absolute)
subtraction_3 = Subtraction(A=deconstruct_domain_3.Start, B=absolute)
addition_3 = Addition(A=deconstruct_domain_3.End, B=absolute)
number = Number(deconstruct.XComponent)
number_2 = Number(deconstruct.YComponent)
number_3 = Number(deconstruct.ZComponent)
larger_than = LargerThan(FirstNumber=number, SecondNumber=subtraction)  # -> LargerThan, OrEqualTo
smaller_than = SmallerThan(FirstNumber=number, SecondNumber=addition)  # -> SmallerThan, OrEqualTo
larger_than_2 = LargerThan(FirstNumber=number_2, SecondNumber=subtraction_2)  # -> LargerThan, OrEqualTo
smaller_than_2 = SmallerThan(FirstNumber=number_2, SecondNumber=addition_2)  # -> SmallerThan, OrEqualTo
larger_than_3 = LargerThan(FirstNumber=number_3, SecondNumber=subtraction_3)  # -> LargerThan, OrEqualTo
smaller_than_3 = SmallerThan(FirstNumber=number_3, SecondNumber=addition_3)  # -> SmallerThan, OrEqualTo
gate_and = GateAnd(A=larger_than.OrEqualTo, B=smaller_than.OrEqualTo)
gate_and_2 = GateAnd(A=larger_than_2.OrEqualTo, B=smaller_than_2.OrEqualTo)
gate_and_3 = GateAnd(A=larger_than_3.OrEqualTo, B=smaller_than_3.OrEqualTo)
c_script = CSharpScript(value=X_2, bool=gate_and)  # -> out, result
# ---------- c_script: C# ----------
    if(_value == null)
      result_ = true;
    else result_ = _bool;
# ---------- end c_script ----------
c_script_2 = CSharpScript(value=Y_2, bool=gate_and_2)  # -> out, result; same code as c_script
c_script_3 = CSharpScript(value=Z_2, bool=gate_and_3)  # -> out, result; same code as c_script
gate_and_4 = GateAnd(A=c_script.result, B=c_script_2.result)
gate_and_5 = GateAnd(A=gate_and_4, B=c_script_3.result)
point_3 = Point(point_2)
cull_pattern = CullPattern(List=point_3, CullPattern=gate_and_5)
point_4 = Point(cull_pattern)
point_5 = ClusterOutput(point_4)

# ==== cluster Cluster_2
point = ClusterInput()
box = ClusterInput()
strict = ClusterInput()
tolerance = ClusterInput()
point_2 = Point(point)
box_2 = Box(box)
strict_2 = Boolean(strict)
tolerance_2 = Number(tolerance)
point_in_brep = PointInBrep(Brep=box_2, Point=point_2, Strict=strict_2)
brep_closest_point = BrepClosestPoint(Point=point_2, Brep=box_2)  # -> Point, Normal, Distance
smaller_than = SmallerThan(FirstNumber=brep_closest_point.Distance, SecondNumber=tolerance_2)  # -> SmallerThan, OrEqualTo
gate_or = GateOr(A=point_in_brep, B=smaller_than.OrEqualTo)
cull_pattern = CullPattern(List=point_2, CullPattern=gate_or)
point_3 = Point(cull_pattern)
point_4 = ClusterOutput(point_3)

# ==== cluster Cluster_3
point = ClusterInput()
curve = ClusterInput()
tolerance = ClusterInput()
point_2 = Point(point)
curve_2 = Curve(reparameterize(curve))
tolerance_2 = Number(tolerance)
curve_closest_point = CurveClosestPoint(Point=point_2, Curve=curve_2)  # -> Point, Parameter, Distance
smaller_than = SmallerThan(FirstNumber=curve_closest_point.Distance, SecondNumber=tolerance_2)  # -> SmallerThan, OrEqualTo
cull_pattern = CullPattern(List=point_2, CullPattern=smaller_than.OrEqualTo)
point_3 = Point(cull_pattern)
point_4 = ClusterOutput(point_3)

# ==== cluster Cluster_4
point = ClusterInput()
surface = ClusterInput()
tolerance = ClusterInput()
point_2 = Point(point)
surface_2 = Surface(surface)
tolerance_2 = Number(tolerance)
surface_closest_point = SurfaceClosestPoint(Point=point_2, Surface=surface_2)  # -> Point, UVPoint, Distance
smaller_than = SmallerThan(FirstNumber=surface_closest_point.Distance, SecondNumber=tolerance_2)  # -> SmallerThan, OrEqualTo
cull_pattern = CullPattern(List=point_2, CullPattern=smaller_than.OrEqualTo)
point_3 = Point(cull_pattern)
point_4 = ClusterOutput(point_3)
