# Grasshopper definition 30_MembraneFormFinding.gh (Grasshopper 1.0.7)
# plug-ins: Kangaroo2 Components, Karamba3D

expression = Expression(x=Slider(10, range=0..100), Expression="\"0 to \" & 1/x")
cir = Circle(Plane=PlaneXY(0, 0, 0), Radius=[Slider(40, range=0..100), Slider(100, range=0..100)])
subcrv = SubCurve(BaseCurve=reparameterize(cir), Domain=expression)
panel = Panel(expression)
end = EndPoints(Curve=subcrv)  # -> Start, End
range = Range(Domain=Domain(0, 1), Steps="3")
pline = PolyLine(Vertices=end.Start, Closed=False)
pline_2 = PolyLine(Vertices=end.End, Closed=False)
graph = GraphMapper(
    reverse(range),
    x0=0,
    x1=1,
    y0=0,
    y1=1,
    container_name="Bezier",
    cpx=[0, 0.2316699922, 0.4715136588, 1],
    cpy=[0.346996367, 0.6089203358, 1, 0.5628786087])
eval = EvaluateCurve(Curve=reparameterize(graft([pline, pline_2])), Parameter=range)  # -> Point, Tangent, Angle
flip = FlipMatrix(Data=eval.Point)
bnd = Bounds(Numbers=graph)
remap = RemapNumbers(Value=graph, Source=bnd, Target=Slider(35, range=0..100))  # -> Mapped, Clipped
Z = UnitZ(Factor=remap.Mapped)
move = Move(Geometry=flip, Motion=graft(Z))  # -> Geometry, Transform
loft_opt = LoftOptions(Closed=False, Adjust=False, Rebuild=0, Refit=0, Type="3")
pline_3 = PolyLine(Vertices=move.Geometry, Closed=False)
loft = Loft(Curves=flatten(pline_3), Options=loft_opt)

brep = Brep(loft)
mesh_breps = MeshBrepsKaramba3D(
    Brep=brep,
    MeshResolution="3",
    EdgeRefinementFactor=0.67,
    PointReduction=False,
    SmoothingStepSize="1",
    SmoothingIterations="10")  # -> Mesh, Info
debrep = DeconstructBrep(Brep=brep)  # -> Faces, Edges, Vertices
clean = CombineClean(Meshes=mesh_breps.Mesh)
supports = Point(flatten(debrep.Vertices))
medges = MeshEdges(Mesh=clean)  # -> NakedEdges, InteriorEdges, NonManifoldEdges
crv = Curve(medges.NakedEdges)
edgelengths = EdgeLengths(Mesh=clean, LengthFactor=Slider(0.01, range=0.01..0.8), Strength="1")
anchor = Anchor(Point=supports, Strength="10000")
length_line = LengthLine(Line=crv, Length="0.1", Strength="20")
vertexloads = VertexLoads(Mesh=clean, Strength="-0.05")
show = Show(G=supports)  # -> flatten(G)
show_2 = Show(G=clean)  # -> flatten(G)
entwine = Entwine(Branch00=show, Branch01=show_2, Branch02=[vertexloads, anchor, edgelengths, length_line], FlattenInputs=True)
zombiesolver = ZombieSolver(GoalObjects=flatten(entwine), Threshold=1e-10, Tolerance=0.0001, MaxIterations=50000)  # -> I, V, O
match = MatchTree(Tree=graft(zombiesolver.O), Guide=graft(entwine))
trim = TrimTree(Tree=match, Depth=1)
bang = ExplodeTree(Data=trim)  # -> Branch0, Branch1, Branch2

mesh = Mesh(bang.Branch1)
matprops = MaterialPropertiesKaramba3D(
    FamilyOfMaterial="Steel",
    Name="S235",
    YoungsModulus_kN_cm2="2130",
    InPlaneShearModulus_kN_cm2="1000",
    TransverseShearModulus_kN_cm2="1000",
    SpecificWeight_kN_m3="20",
    CoefficientOfThermalExpansion_1_C=1.2e-05,
    TensileStrength_kN_cm2=23.5,
    CompressiveStrength_kN_cm2=-23.5,
    StrengthHypothesis="MISES",
    mode="Isotrop")
cross_section = CrossSectionKaramba3D(FamilyNameOfCrossSection="DefaultCroSec", Material=matprops, Height_cm="5", mode="Shell - Const")
pt = Point(bang.Branch0)
supp = SupportKaramba3D(PosInd=pt, menu=[buttons(on, on, on, off, off, off)])
loads = LoadsKaramba3D(Eps0="-1", LCase="0", mode="InitialStrain")
loads_2 = LoadsKaramba3D(Vector=Vector(0, 0, -1), LCase="0", mode="Gravity")
meshtoshell = MeshToShellKaramba3D(Mesh=mesh, CrossSection=cross_section, LimitDistance_m=0.005, Bending="0")  # -> Element, Points, Info
load = LoadKaramba(flatten([loads, loads_2]))
assemble = AssembleModelKaramba3D(Elem=flatten(meshtoshell.Element), Support=flatten(supp), Load=flatten(load), LimitDistance_m=0.005)  # -> Model, Info, Mass_kg, CenterOfGravity, LoadCaseNames
panel_2 = Panel(assemble.Mass_kg)
analyzethii = AnalyzeThIIKaramba3D(Model=assemble.Model, LoadCase="-1", RTolerance=1e-07, MaxIterations=50, NoTensionalNII=False)  # -> CalculatedModel, MaximumDisplacement_cm, ResultingForceOfGravity_kN, ElasticEnergyChange_kNm
item = ListItem(List=flatten(pline_3), Index=0, Wrap=True)
xy = XYPlane(Origin=Point(0, 0, 0))
brep_2 = Brep(brep)
align = AlignPlane(Plane=xy, Direction=item)  # -> Plane, Angle
panel_3 = Panel(analyzethii.MaximumDisplacement_cm)
bbox = BoundingBox(Content=brep_2, Plane=align.Plane)  # -> Box, Box_2
modelview = ModelViewKaramba3D(Model=analyzethii.CalculatedModel, ResultFactors=1, ResultCase=-1)  # -> Model, DeformedMesh, DeformedAxes, DeformedModel
box = EvaluateBox(Box=bbox.Box, UParameter=Slider(0.454, range=0..1), VParameter=0.5, WParameter=0.5)  # -> Plane, Point, Include
pl = PlaneNormal(Origin=box.Point, ZAxis=item)
shellview = ShellViewKaramba3D(Model=modelview.Model, IndexOfLayer=0)  # -> Model, MeshesOfRenderedShells, LegendColors, LegendTags
yz = YZPlane(Origin=box.Point)
sec = BrepPlane(Brep=brep_2, Plane=pl)  # -> Curves, Points
legend = Legend(Colour=shellview.LegendColors, Tags=shellview.LegendTags, LegendType=1)
s_forces = ShellSectionKaramba3D(
    AnalyzedModel=modelview.Model,
    Polyline=sec.Curves,
    ProjectionDirection=Vector(0, 0, -1),
    mode="Forces",
    menu=[checkbox(on), checkbox(off), checkbox(on), slider(10), slider(0.1), slider(0.52), checkbox(on), checkbox(off), checkbox(off), checkbox(off), checkbox(off), checkbox(off), checkbox(off), checkbox(off), checkbox(off), slider(1)])  # -> AnalyzedModel, Polylines, FaceIndexes, MeshesOfRenderedResults, CurvesOfRenderedResults, Ntt_kN_m, Nnn_kN_m, Ntn_kN_m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
